# Grasshopper definition Import_Edges_P5_to_Rhino_via_Grasshopper.gh (Grasshopper 1.0.7)
# plug-ins: jSwan

scale_factor = DigitScroller(Scroller_Digits=12, Scroller_Prefix="Scale factor", Scroller_Radix=9, Scroller_Value=6.773)
digit_scroller = DigitScroller(Scroller_Digits=12, Scroller_Prefix="translateX", Scroller_Radix=9, Scroller_Value=0)
translatey = DigitScroller(Scroller_Digits=12, Scroller_Prefix="translateY", Scroller_Radix=9, Scroller_Value=0)
translatez = DigitScroller(Scroller_Digits=12, Scroller_Prefix="translateZ", Scroller_Radix=9, Scroller_Value=4500)
digit_scroller_2 = DigitScroller(Scroller_Digits=12, Scroller_Prefix="scale", Scroller_Radix=9, Scroller_Value=3)
digit_scroller_3 = DigitScroller(Scroller_Digits=12, Scroller_Prefix="translateX", Scroller_Radix=9, Scroller_Value=-426)
translatey_2 = DigitScroller(Scroller_Digits=12, Scroller_Prefix="translateY", Scroller_Radix=9, Scroller_Value=0)
translatez_2 = DigitScroller(Scroller_Digits=12, Scroller_Prefix="translateZ", Scroller_Radix=9, Scroller_Value=558)
dejson = DeserializeJson(OutputsLocked=False)
import_simple_bezier = GhPythonScript(scale=digit_scroller_2, translateX=digit_scroller_3, translateY=translatey_2, translateZ=translatez_2)  # -> out, technology, methodology, process, knwFramework, other
# ---------- import_simple_bezier: Python ----------
"""Provides a scripting component.
    Inputs:
        x: The x script variable
        y: The y script variable
    Output:
        a: The a output variable
        b: another ouput variable"""

__author__ = "jsal"

import rhinoscriptsyntax as rs
import Rhino.Geometry as rg
import Rhino.Collections as rc
import json
import math

print "Instructions: "

#prompt the user for a file to import
filter = "JSON file (*.json)|*.json|All Files (*.*)|*.*||"
filename = rs.OpenFileName("Open JSON File", filter)

print "File name: " + filename
#Read JSON data into the datastore variable
if filename:
    with open(filename, 'r') as f:
        edges = json.load(f)

# The collections of beziers and nurbs
# I first create beziers and then nurbs. Apparently I cannot draw beziers directly
beziersTechnology = []
beziersMethodology = []
beziersProcess = []
beziersKnwFramework = []
beziersOther = []

#https://sites.math.washington.edu/~king/coursedir/m308a01/Projects/m308a01-pdf/yip.pdf
matrix = []
matrix.append( [scale, 0, 0, translateX] )
matrix.append( [0, scale, 0, translateY] )
matrix.append( [0, 0, scale, translateZ] )
matrix.append( [0, 0, 0, 1] )


for x in range(0,len(edges)):
    points = rc.Point3dList()
    coords = edges[x]['controlPoints']

    """IMPORTANT 
        Y and Z coordenates are switched to rotate on transfor 2D in 3D
        Y Coordinates increase goind downwards. In Rhino Y increases upwards. As a result
        the coordinate system is fliped. That is the reson why Z coordinates are negative here
    """ 
    # Control points 
    org = rg.Point3d(coords['org'][0],coords['org'][2],-coords['org'][1])
    orgControl = rg.Point3d(coords['orgControl'][0],coords['orgControl'][2],-coords['orgControl'][1])
    endControl = rg.Point3d(coords['endControl'][0],coords['endControl'][2],-coords['endControl'][1])
    end = rg.Point3d(coords['end'][0],coords['end'][2],-coords['end'][1])
    
    #scale each of the bezier points
    #org = org*scale
    #orgControl = orgControl*scale
    #endControl = endControl*scale
    #end = end*scale
    
    #https://developer.rhino3d.com/api/RhinoScriptSyntax/#collapse-TransformObject
    rs.TransformObject(org,matrix)
    rs.TransformObject(orgControl,matrix)
    rs.TransformObject(endControl,matrix)
    rs.TransformObject(end,matrix)
    
    points.Add(org)
    points.Add(orgControl)
    points.Add(endControl)
    points.Add(end)
    
    
    bezier = rg.BezierCurve(points)
    
    if (edges[x]['edge']['kind'] == 'Technology'):
        beziersTechnology.append(bezier)
    elif(edges[x]['edge']['kind'] == 'Methodology'):
        beziersMethodology.append(bezier)
    elif(edges[x]['edge']['kind'] == 'Process'):
        beziersProcess.append(bezier)
    elif(edges[x]['edge']['kind'] == 'Knowledge Framework'):
        beziersKnwFramework.append(bezier)
    else:
        beziersOther.append(rg.BezierCurve(points))

print translateX

# The nurms to be drawn on Rhino's canvas
#nurbs = []

#for x in range(0,len(beziersTechnology)):
#    nurbs.append(beziersTechnology[x].ToNurbsCurve())


 
technology = beziersTechnology
methodology = beziersMethodology
process = beziersProcess
knwFramework = beziersKnwFramework
other = beziersOther
# ---------- end import_simple_bezier ----------
ribbons_script = GhPythonScript(scale=digit_scroller_2, translateX=digit_scroller_3, translateY=translatey_2, translateZ=translatez_2)  # -> out, theme1, theme2, theme3, curve, points
# ---------- ribbons_script: Python ----------
"""Provides a scripting component.
    Inputs:
        x: The x script variable
        y: The y script variable
    Output:
        a: The a output variable
        b: another ouput variable"""

__author__ = "jsal"

import rhinoscriptsyntax as rs
import Rhino.Geometry as rg
import Rhino.Collections as rc
import json
import math

print "Instructions: "

#prompt the user for a file to import
filter = "JSON file (*.json)|*.json|All Files (*.*)|*.*||"
#filename = rs.OpenFileName("Open JSON File", filter)
filename = "/Users/jsal/Documents/GitHub/Siebel Center for Design/mural_SCD/sandbox/p5ToIllustrator/files/themeFlow (2).json"

print "File name: " + filename
#Read JSON data into the datastore variable
if filename:
    with open(filename, 'r') as f:
        themeFlowData = json.load(f)

# The collections of beziers and nurbs
# I first create beziers and then nurbs. Apparently I cannot draw beziers directly
bezierTheme5 = []
#beziersMethodology = []
#beziersProcess = []
#beziersKnwFramework = []
#beziersOther = []

#https://sites.math.washington.edu/~king/coursedir/m308a01/Projects/m308a01-pdf/yip.pdf
matrix = []
matrix.append( [scale, 0, 0, translateX] )
matrix.append( [0, scale, 0, translateY] )
matrix.append( [0, 0, scale, translateZ] )
matrix.append( [0, 0, 0, 1] )

print(len(themeFlowData['ribbons'][0]['points'])) # there are 11

points = rc.Point3dList()

for x in range(0,len(themeFlowData['ribbons'][0]['points'])):
    
    coords = themeFlowData['ribbons'][0]['points'][x]

    """IMPORTANT 
        Y and Z coordenates are switched to rotate on transfor 2D in 3D
        Y Coordinates increase goind downwards. In Rhino Y increases upwards. As a result
        the coordinate system is fliped. That is the reson why Z coordinates are negative here
    """ 
    
    #print(coords[x])
    
    # Control points 
    org = rg.Point3d(coords['anchorX'],0,-coords['anchorY'])
    orgControl = rg.Point3d(coords['controlLeftX'],0,-coords['controlLeftY'])
    endControl = rg.Point3d(coords['controlRightX'],0,-coords['controlRightY'])
    
    #scale each of the bezier points
    #org = org*scale
    #orgControl = orgControl*scale
    #endControl = endControl*scale
    #end = end*scale
    
    #https://developer.rhino3d.com/api/RhinoScriptSyntax/#collapse-TransformObject
    rs.TransformObject(org,matrix)
    rs.TransformObject(orgControl,matrix)
    rs.TransformObject(endControl,matrix)
    
    #points.Add(org)
    points.Add(orgControl)
    points.Add(endControl)

    
    
bezierTheme5 = rg.BezierCurve(points)
    
#    if (edges[x]['edge']['kind'] == 'Technology'):
#        beziersTheme1.append(bezier)
#    elif(edges[x]['edge']['kind'] == 'Methodology'):
#        beziersTheme2.append(bezier)
#    elif(edges[x]['edge']['kind'] == 'Process'):
#        beziersTheme3.append(bezier)
#    elif(edges[x]['edge']['kind'] == 'Knowledge Framework'):
#        beziersTheme4.append(bezier)
#    else:
#        beziersTheme5.append(rg.BezierCurve(points))

# The nurms to be drawn on Rhino's canvas
#nurbs = []

#for x in range(0,len(beziersTechnology)):
#    nurbs.append(beziersTechnology[x].ToNurbsCurve())


print(bezierTheme5.ToNurbsCurve())
#theme1 = beziersTechnology
#theme2 = beziersMethodology
#theme3 = beziersProcess
curve = bezierTheme5.ToNurbsCurve()

a= points
# ---------- end ribbons_script ----------
# Import data from JSON file and return control points
chords_script = GhPythonScript(scale=scale_factor, translateX=digit_scroller, translateY=translatey, translateZ=translatez)  # -> out, originsOut, endsOut, controlsOrgOut, controlsEndOut
# ---------- chords_script: Python ----------
"""Provides a scripting component.
    Inputs:
        x: The x script variable
        y: The y script variable
    Output:
        a: The a output variable
        b: another ouput variable"""

__author__ = "jsal"

import rhinoscriptsyntax as rs
import Rhino.Geometry as rg
import Rhino.Collections as rc
import json
import math

#prompt the user for a file to import
filter = "JSON file (*.json)|*.json|All Files (*.*)|*.*||"
filename = rs.OpenFileName("Open JSON File", filter)
#filename = "/Users/jsal/Documents/GitHub/Siebel Center for Design/mural_SCD/sandbox/p5ToIllustrator/files/themeFlow_april11.json"

print "File name: " + filename
#Read JSON data into the datastore variable
if filename:
    with open(filename, 'r') as f:
        themeFlowData = json.load(f)

# The collections of points
origins = rc.Point3dList()
ends = rc.Point3dList()
controlsOrg = rc.Point3dList()
controlsEnd = rc.Point3dList()


#https://sites.math.washington.edu/~king/coursedir/m308a01/Projects/m308a01-pdf/yip.pdf
matrix = []
matrix.append( [scale, 0, 0, translateX] )
matrix.append( [0, scale, 0, translateY] )
matrix.append( [0, 0, scale, translateZ] )
matrix.append( [0, 0, 0, 1] )

for i in range (0,len(themeFlowData['chords'])):
    chord = themeFlowData['chords'][i]

    for j in range(0,len(chord['points'])):
        
        bezierData = chord['points'][j]

        """IMPORTANT 
            Y and Z coordenates are switched to rotate on transform 2D in 3D
            Y Coordinates increase downwards. In Rhino Y increases upwards. As a result
            the coordinate system is fliped. That is the reson why Z coordinates are 
            negative here
        """ 
        
        #print(bezierData)
        
        # Control points 
        z = 0
        org = rg.Point3d(bezierData['orgX'],z,-bezierData['orgY'])
        end = rg.Point3d(bezierData['endX'],z,-bezierData['endY'])
        
        deltaOrgX = bezierData['orgControlX'] - bezierData['orgX']
        deltaOrgY = bezierData['orgControlY'] - bezierData['orgY']
        deltaEndX = bezierData['endControlX'] - bezierData['endX']
        deltaEndY = bezierData['endControlY'] - bezierData['endY']
        
        orgControl = rg.Point3d(deltaOrgX, z,deltaOrgY)
        endControl = rg.Point3d(deltaEndX, z,deltaEndY)
        
        #scale each of the bezier points
        #org = org*scale
        orgControl = orgControl*scale
        endControl = endControl*scale
        #end = end*scale
        
        #https://developer.rhino3d.com/api/RhinoScriptSyntax/#collapse-TransformObject
        rs.TransformObject(org,matrix)
        rs.TransformObject(end,matrix)
        #rs.TransformObject(orgControl,matrix)
        #rs.TransformObject(endControl,matrix)
        
        origins.Add(org)
        ends.Add(end)
        controlsOrg.Add(orgControl)
        controlsEnd.Add(endControl)

originsOut = origins
endsOut = ends
controlsOrgOut = controlsOrg
controlsEndOut = controlsEnd
# ---------- end chords_script ----------
list = ValueList({"One": 1, "Two": 2, "Three": 3}, selected="Two")
list_2 = ValueList({"t": true, "f": false}, selected="f")
list_3 = ValueList({"uniform": 0, "chord": 1, "sqrtchord": 2}, selected="chord")
panel = Panel(import_simple_bezier.out)
panel_2 = Panel(ribbons_script.out)
panel_3 = Panel(chords_script.out)
vec = Vector(chords_script.controlsOrgOut)
vec_2 = Vector(chords_script.controlsEndOut)
tech = GhPythonScript(x=import_simple_bezier.technology)  # -> out, a; inputs x: list
# ---------- tech: Python ----------
__author__ = "jsal"

import rhinoscriptsyntax as rs
import Rhino.Geometry as rg
import Rhino.Collections as rc

beziers = x

nurbs = []

for i in range(0,len(beziers)):
    nurbs.append(beziers[i].ToNurbsCurve())
    

a= nurbs
# ---------- end tech ----------
meth = GhPythonScript(x=import_simple_bezier.methodology)  # -> out, a; inputs x: list; same code as tech
proc = GhPythonScript(x=import_simple_bezier.process)  # -> out, a; inputs x: list; same code as tech
kfwk = GhPythonScript(x=import_simple_bezier.knwFramework)  # -> out, a; inputs x: list; same code as tech
other = GhPythonScript(x=import_simple_bezier.other)  # -> out, a; inputs x: list
# ---------- other: Python ----------
__author__ = "jsal"

import rhinoscriptsyntax as rs
import Rhino.Geometry as rg
import Rhino.Collections as rc

beziers = x

nurbs = []

for i in range(0,len(beziers)):
    nurbs.append(beziers[i].ToNurbsCurve())
    

a = nurbs
# ---------- end other ----------
nurbs = NurbsCurve(Vertices=ribbons_script.points, Degree=list, Periodic=list_2)  # -> Curve, Length, Domain
intcrv = Interpolate(Vertices=ribbons_script.points, Degree=list, Periodic=list_2, KnotStyle=list_3)  # -> Curve, Length, Domain
# Create individual beziers
bzspan = BezierSpan(StartPoint=chords_script.originsOut, StartTangent=vec, EndPoint=chords_script.endsOut, EndTangent=vec_2)  # -> Curve, Length, Domain
# Create chord from squential beziers
join = JoinCurves(Curves=bzspan.Curve, Preserve=False)
int = Integer(1)
from_0 = Series(Start=0, Step=int, Count=10)
from_1 = Series(Start=1, Step=int, Count=10)
# Create surfaces from alternated chords
curve_a = ListItem(List=join, Index=from_0, Wrap=True)
curve_b = ListItem(List=join, Index=from_1, Wrap=True)
rulesrf = RuledSurface(CurveA=curve_a, CurveB=curve_b)
offset = DigitScroller(Scroller_Digits=12, Scroller_Prefix="offset", Scroller_Radix=9, Scroller_Value=12.7)
Y = UnitY(Factor=offset)
offset_2 = OffsetSurface(Surface=rulesrf, Distance=Y, Retrim=True)
