# Grasshopper definition Import_TangibleNodes_P5_to_Rhino_via_Grasshopper.gh (Grasshopper 1.0.7)

# Use the menu of this element to link your JSON file
right_click_and_use_options_in_menu = FilePath("/Users/jsal/Downloads/jsonCPoints (1).json")
scale_factor = DigitScroller(Scroller_Digits=12, Scroller_Prefix="Scale factor", Scroller_Radix=9, Scroller_Value=1.5)
digit_scroller = DigitScroller(Scroller_Digits=12, Scroller_Prefix="translateX", Scroller_Radix=9, Scroller_Value=0)
translatey = DigitScroller(Scroller_Digits=12, Scroller_Prefix="translateY", Scroller_Radix=9, Scroller_Value=0)
translatez = DigitScroller(Scroller_Digits=12, Scroller_Prefix="translateZ", Scroller_Radix=9, Scroller_Value=0)
# Pebble height
pebble_height = DigitScroller(Scroller_Digits=12, Scroller_Prefix="Pebble Height", Scroller_Radix=9, Scroller_Value=41)
# Phyton script to read data and generate assets for base curves
pebbels_script = GhPythonScript(
    filePath=right_click_and_use_options_in_menu,
    scale=scale_factor,
    translateX=digit_scroller,
    translateY=translatey,
    translateZ=translatez,
    pebbleHeight=pebble_height)  # -> out, originsOut, endsOut, controlsOrgOut, controlsEndOut, centers, heightOut, idsOut, innovationNamesOut
# ---------- pebbels_script: Python ----------
"""Provides a scripting component.
    Inputs:
        x: The x script variable
        y: The y script variable
    Output:
        a: The a output variable
        b: another ouput variable"""

__author__ = "jsal"

import rhinoscriptsyntax as rs
import Rhino.Geometry as rg
import Rhino.Collections as rc
import json
import math

#prompt the user for a file to import
filter = "JSON file (*.json)|*.json|All Files (*.*)|*.*||"
filename = filePath
#filename = rs.OpenFileName("Open JSON File", filter)
#filename = "/Users/jsal/Documents/GitHub/Siebel Center for Design/mural_SCD/sandbox/p5ToIllustrator/files/themeFlow_april11.json"

#print "File name: " + filename
#Read JSON data into the datastore variable
if filename:
    with open(filename, 'r') as f:
        data = json.load(f)



# The collections of points
origins = rc.Point3dList()
ends = rc.Point3dList()
controlsOrg = rc.Point3dList()
controlsEnd = rc.Point3dList()
centers = rc.Point3dList()
heights = rc.Point3dList()
ids = []
names =[]




#https://sites.math.washington.edu/~king/coursedir/m308a01/Projects/m308a01-pdf/yip.pdf
matrix = []
matrix.append( [scale, 0, 0, translateX] )
matrix.append( [0, scale, 0, translateY] )
matrix.append( [0, 0, scale, translateZ] )
matrix.append( [0, 0, 0, 1] )

for j in range (0,len(data['pebbles'])):
    pebble = data['pebbles'][j]

    center = rg.Point3d(pebble['center']['x'], -pebble['center']['y'],0)
    height = rg.Point3d(pebble['center']['x'], -pebble['center']['y'],pebbleHeight)
    
    # scale and transform
    center = center*scale
    rs.TransformObject(center,matrix)
    
    height = height*scale
    rs.TransformObject(height,matrix)
    
    centers.Add(center)
    heights.Add(height)
    
    ids.Add(pebble['id'])
    names.Add(pebble['innovationTitle'])

    for i in range (0,len(pebble['points'])):
            
        bezierData = pebble['points'][i]

        """
        IMPORTANT 
                Y and Z coordenates are switched to rotate on transform 2D in 3D
                Y Coordinates increase downwards. In Rhino Y increases upwards. As a result
                the coordinate system is fliped. That is the reson why Z coordinates are 
                negative here
        """ 
            
        # Control points 
        z = 0
        org = rg.Point3d(bezierData['orgX'],-bezierData['orgY'],z)
        end = rg.Point3d(bezierData['endX'],-bezierData['endY'],z)
        orgControl = rg.Point3d(bezierData['orgControlX'],-bezierData['orgControlY'],z)
        endControl = rg.Point3d(bezierData['endControlX'],-bezierData['endControlY'],z)
            
        #scale each of the bezier points
        org = org*scale
        end = end*scale
        orgControl = orgControl*scale
        endControl = endControl*scale
        
        deltaOrg = rg.Point3d(orgControl - end)
        deltaEnd = rg.Point3d(endControl - org)
            
        #https://developer.rhino3d.com/api/RhinoScriptSyntax/#collapse-TransformObject
        rs.TransformObject(org,matrix)
        rs.TransformObject(end,matrix)
            
        origins.Add(rg.Point3d(org))
        ends.Add(rg.Point3d(end))
        controlsOrg.Add(rg.Point3d(deltaEnd))
        controlsEnd.Add(rg.Point3d(deltaOrg))


originsOut = origins
endsOut = ends
controlsOrgOut = controlsOrg
controlsEndOut = controlsEnd
centers = centers
idsOut = ids
innovationNamesOut = names
heightOut = heights
# ---------- end pebbels_script ----------
panel = Panel(pebbels_script.out)

# ----
# Pebble central axis
pebble_base_center_point = Point(pebbels_script.centers)
pebble_top_center_point = Point(pebbels_script.heightOut)

# ----
# Base curves from data
pt = Point(pebbels_script.originsOut)
vec = Vector(pebbels_script.controlsOrgOut)
pt_2 = Point(pebbels_script.endsOut)
vec_2 = Vector(pebbels_script.controlsEndOut)
scale = Multiplication(A=vec, B=scale_factor)
scale_2 = Multiplication(A=vec_2, B=scale_factor)
bzspan = BezierSpan(StartPoint=pt, StartTangent=scale, EndPoint=pt_2, EndTangent=scale_2)  # -> Curve, Length, Domain
join = JoinCurves(Curves=bzspan.Curve, Preserve=False)

# ----
# Start point for shell rib
control_points = ControlPoints(Curve=join)  # -> Points, Weights, Knots
int = Integer(0)
list_item = ListItem(List=control_points.Points, Index=int, Wrap=True)
origin_bezier_on_base_curve_point = Point(list_item)
flatten = FlattenTree(Tree=origin_bezier_on_base_curve_point, Path="{0}")

# ----
# Control points of bezier for shell rib
number_slider = Slider(0, range=0..500)
construct_point = ConstructPoint(XCoordinate=Slider(0, range=0..500), YCoordinate=Slider(42.27023, range=0..500), ZCoordinate=Slider(0, range=0..500))
construct_point_2 = ConstructPoint(XCoordinate=number_slider, YCoordinate=Slider(0, range=0..500), ZCoordinate=Slider(35.92141, range=0..500))
squared = Square(Value=scale_factor)
scale_3 = Multiplication(A=construct_point_2, B=squared)
scale_4 = Multiplication(A=construct_point, B=squared)

# ----
# Generate shell rib
ribs_bezier_span = BezierSpan(StartPoint=flatten, StartTangent=scale_3, EndPoint=pebble_top_center_point, EndTangent=scale_4)  # -> Curve, Length, Domain
line = Line(StartPoint=pebble_top_center_point, EndPoint=pebble_base_center_point)

# ----
# BAKE IT
# Pebble shell thickness
# Innovation name
rail_revolution = RailRevolution(Curve=ribs_bezier_span.Curve, Rail=join, Axis=line, Scale=False)
font_size = Integer(3)
tag = TextTag3D(Location=pebble_base_center_point, Text=pebbels_script.innovationNamesOut, Size=font_size, Justification=7)
bool = Boolean(False)
offset_surface = OffsetSurface(Surface=rail_revolution, Distance=Slider(22.857, range=-100..100), Retrim=bool)
curve = Curve(rail_revolution)
curve_2 = Curve(offset_surface)
ruled_surface = RuledSurface(CurveA=curve, CurveB=curve_2)

# ----
# This group draws the penta-stars and prepare elements for manual trimming
# Bake this to manually do the trimming
height = Slider(98.095, range=-100..100)
y_size = Slider(34.285, range=-100..100)
xy = XYPlane(Origin=Point(0, 0, 0))
rectangle = Rectangle(Plane=xy, XSize=Slider(373.529, range=0..500), YSize=y_size, Radius=0)  # -> Rectangle, Length
boxrec = BoxRectangle(Rectangle=rectangle.Rectangle, Height=height)
_5 = Integer(5)
arrpolar = PolarArray(Geometry=boxrec, Plane=xy, Count=_5, Angle=6.283185307)  # -> Geometry, Transform
sunion = SolidUnion(Breps=arrpolar.Geometry)
move = Move(Geometry=sunion, Motion=pebble_base_center_point)  # -> Geometry, Transform
cap = CapHoles(Brep=offset_surface)
